# Grasshopper definition Daylight_simulation.gh (Grasshopper 1.0.7)
# plug-ins: FalseStartToggle, Colibri

ladybug = Ladybug_Ladybug()  # -> Vviiiiiiiiiizzz; plug-in component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
honeybee = Honeybee_Honeybee()  # -> Vviiiiiiiiiizzz; plug-in component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
office_length = ValueList({"4,5": 4.5, "5,5": 5.5, "6,5": 6.5}, selected="6,5")
# Convert the box to Honeybee zone
# All the material will be set to default
# In case you want to change them search
# for Honeybee_Set Radiance Materials
# component.
panel = Panel("2.7")

# ----
# EP Construction materials
# for the window
panel_2 = Panel("Glass")
epglassmat = Honeybee_EnergyPlusGlassMaterial(name=panel_2, thickness="0.004", solarTransmittance="0.7")  # -> EPMaterial; plug-in component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
epwindowairgap = Honeybee_EnergyPlusWindowAirGap(name="Air gap", thickness="0.012")  # -> EPMaterial; plug-in component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
epconstruction = Honeybee_EnergyPlusConstruction(name="Window", layer_1=epglassmat, layer_2=epwindowairgap, layer_3=epglassmat)  # -> EPConstruction; plug-in component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

# ----
# Create shadings
number_slider = Slider(2.65, range=0..10)
shading_depth = ValueList({"30": 0.30, "45": 0.45, "60": 0.6}, selected="60")
pt = ConstructPoint(XCoordinate=0, YCoordinate=expr("-x", shading_depth), ZCoordinate=0)
xz = XZPlane(Origin=Point(0, 0, 0))
pt_2 = ConstructPoint(XCoordinate=0, YCoordinate=0, ZCoordinate=0)
pt_3 = ConstructPoint(XCoordinate=number_slider, YCoordinate=0, ZCoordinate=panel)
xz_2 = XZPlane(Origin=pt)
pt_4 = ConstructPoint(XCoordinate=0, YCoordinate=expr("-x", shading_depth), ZCoordinate=0)
pt_5 = ConstructPoint(XCoordinate=number_slider, YCoordinate=expr("-x", shading_depth), ZCoordinate=panel)
rec_2pt = Rectangle2Pt(Plane=xz, PointA=pt_2, PointB=pt_3, Radius=0)  # -> Rectangle, Length
rec_2pt_2 = Rectangle2Pt(Plane=xz_2, PointA=pt_4, PointB=pt_5, Radius=0)  # -> Rectangle, Length
boundary = BoundarySurfaces(Edges=rec_2pt.Rectangle)
boundary_2 = BoundarySurfaces(Edges=rec_2pt_2.Rectangle)
sdivide = DivideSurface(Surface=boundary, UCount="5", VCount="1")  # -> Points, Normals, Parameters
sdivide_2 = DivideSurface(Surface=boundary_2, UCount="5", VCount="1")  # -> Points, Normals, Parameters
split = SplitList(List=sdivide.Points, Index="1")  # -> ListA, ListB
split_2 = SplitList(List=sdivide_2.Points, Index="1")  # -> ListA, ListB
yz = YZPlane(Origin=split.ListA)
number_slider_2 = Slider(0.3, range=0..1)
rec_2pt_3 = Rectangle2Pt(Plane=yz, PointA=split.ListA, PointB=split_2.ListB, Radius=0)  # -> Rectangle, Length
boxrec = BoxRectangle(Rectangle=rec_2pt_3.Rectangle, Height=Slider(0.05, range=0..0.1))
mass2zone = Honeybee_Masses2Zones(zoneMasses=flatten(boxrec), maxRoofAngle=30, createHBZones=Toggle(True))  # -> readMe, HBZones; plug-in component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
radopaquematerial = Honeybee_RadianceOpaqueMaterial(
    materialName="Shading",
    RReflectance=number_slider_2,
    GReflectance=number_slider_2,
    BReflectance=number_slider_2,
    roughness=0.05,
    specularity=0)  # -> avrgRef, RADMaterial; plug-in component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
wires = BrepWireframe(Brep=boxrec, Density=-1)
setradmaterials = Honeybee_SetRadianceMaterials(
    HBObject=mass2zone.HBZones,
    wallRADMaterial=radopaquematerial.RADMaterial,
    windowRADMaterial=radopaquematerial.RADMaterial,
    roofRADMaterial=radopaquematerial.RADMaterial,
    floorRADMaterial=radopaquematerial.RADMaterial,
    ceilingRADMaterial=radopaquematerial.RADMaterial)  # -> simplify(modifiedHBObject); plug-in component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

box = DomainBox(Base=PlaneXY(0, 0, 0), X="2.7", Y=office_length, Z=panel)
mass2zone_2 = Honeybee_Masses2Zones(zoneMasses=flatten(box), isConditioned=True, maxRoofAngle=30, createHBZones=Toggle(True))  # -> readMe, HBZones; plug-in component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

# ----
# Radiance materials
# for the walls
number_slider_3 = Slider(0.7, range=0..1)
number_slider_4 = Slider(0.3, range=0..1)
number_slider_5 = Slider(0.5, range=0..1)
radopaquematerial_2 = Honeybee_RadianceOpaqueMaterial(
    materialName="Ceiling",
    RReflectance=number_slider_3,
    GReflectance=number_slider_3,
    BReflectance=number_slider_3,
    roughness=0.05,
    specularity=0)  # -> avrgRef, RADMaterial; plug-in component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
radopaquematerial_3 = Honeybee_RadianceOpaqueMaterial(
    materialName="Wall",
    RReflectance=number_slider_5,
    GReflectance=number_slider_5,
    BReflectance=number_slider_5,
    roughness=0.05,
    specularity=0)  # -> avrgRef, RADMaterial; plug-in component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
radopaquematerial_4 = Honeybee_RadianceOpaqueMaterial(
    materialName="Floor",
    RReflectance=number_slider_4,
    GReflectance=number_slider_4,
    BReflectance=number_slider_4,
    roughness=0.05,
    specularity=0)  # -> avrgRef, RADMaterial; plug-in component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
setradmaterials_2 = Honeybee_SetRadianceMaterials(
    HBObject=mass2zone_2.HBZones,
    wallRADMaterial=radopaquematerial_3.RADMaterial,
    floorRADMaterial=radopaquematerial_4.RADMaterial,
    ceilingRADMaterial=radopaquematerial_2.RADMaterial)  # -> simplify(modifiedHBObject); plug-in component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

# ----
# Create glazing based
# on percentage
glazing_percent = ValueList({"40%": 0.40, "45%": 0.45, "50%": 0.50, "55%": 0.55, "60%": 0.60, "65%": 0.65}, selected="65%")
glzparamlist = Honeybee_GlazingParametersList(northGlzParam=0, westGlzParam=0, southGlzParam=glazing_percent, eastGlzParam=0)  # -> glzParamList; plug-in component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
glazingcreator = Honeybee_GlazingBasedOnRatio(
    HBObjects=setradmaterials_2,
    glzRatio=glzparamlist,
    windowHeight=Slider(1.8, range=0..1.8),
    sillHeight=Slider(0.9, range=0..1),
    EPConstructions=epconstruction,
    runIt=Toggle(True))  # -> readMe, HBObjWGLZ; plug-in component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

# ----
# Create ground in front of the room
# for more accurate analysis
number_slider_6 = Slider(0.2, range=0..1)
pt_6 = ConstructPoint(XCoordinate="2.7", YCoordinate=expr("-x", office_length), ZCoordinate=0)
pt_7 = ConstructPoint(XCoordinate=0, YCoordinate=0, ZCoordinate=0)
rec_2pt_4 = Rectangle2Pt(Plane=PlaneXY(0, 0, 0), PointA=pt_7, PointB=pt_6, Radius=0)  # -> Rectangle, Length
radopaquematerial_5 = Honeybee_RadianceOpaqueMaterial(
    materialName="External Floor",
    RReflectance=number_slider_6,
    GReflectance=number_slider_6,
    BReflectance=number_slider_6,
    roughness=0.05,
    specularity=0)  # -> avrgRef, RADMaterial; plug-in component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
boundary_3 = BoundarySurfaces(Edges=rec_2pt_4.Rectangle)
wires_2 = BrepWireframe(Brep=boundary_3, Density=-1)
createhbsrfs = Honeybee_createHBSrfs(geometry=boundary_3, RADMaterial=radopaquematerial_5.RADMaterial)  # -> readMe, simplify(HBSurface); plug-in component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

# ---- group: HB Zone With Glazing
brep = Brep(glazingcreator.HBObjWGLZ)

# ----
panel_3 = Panel("https://energyplus.net/weather-download/europe_wmo_region_6/FRA//FRA_Paris.Orly.071490_IWEC/all")
genhbzonetestpts = Honeybee_GenerateZoneTestPoints(HBZone=brep, gridSize=Slider(0.3, range=0..1), distBaseSrf=Slider(0.7, range=0..1), moveTestMesh=Toggle(True))  # -> readMe, simplify(testPoints), simplify(ptsVectors), simplify(facesArea), simplify(mesh); plug-in component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
wires_3 = BrepWireframe(Brep=brep, Density=-1)
# Paris Orly Weather File
epw_stat = Ladybug_OpenEPWAndSTATWeatherFiles(weatherFileURL=panel_3)  # -> epwFile, statFile; plug-in component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

# ---- group: Run the analysis
toggle = FalseStartToggle(True)

# ----
pt_8 = Point(genhbzonetestpts.testPoints)

# ----
# Occupancy schedule
panel_4 = Panel("""0
0
0
0
0
0
0
0
0
0
0
0
0
0
0
0
0
0
0
0
0
0
0
0""")
panel_5 = Panel("""0
0
0
0
0
0
0
1
1
1
1
1
1
1
1
1
1
1
0
0
0
0
0
0""")
annualschedule = Honeybee_AnnualSchedule(
    sun=panel_4,
    mon=panel_5,
    tue=panel_5,
    wed=panel_5,
    thu=panel_5,
    fri=panel_5,
    sat=panel_4,
    scheduleName="Occupancy office",
    runIt=Toggle(True))  # -> readMe, port, schedule, port_2, weekSched, schedIDFText; plug-in component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

panel_6 = Panel("This light study is conducted for my internship's project in the company Arp-Astrance based in Paris. The aim of the study is for me to learn different factors used in the building industry to evaluate the natural light in a room. My study is about a typical office with variable parameters.")
panel_7 = Panel("""Honeybee
Ladybug
Daylight Simulation""")
toggle_2 = BooleanToggle(True)
button = Button()
exporthydra = Hydra_ExportFile(fileName="Daylight Study", fileDescription=panel_6, fileTags=panel_7, GHForThumb=toggle_2, export=toggle_2)  # -> out; inputs fileDescription: list, changeLog: list, fileTags: list, includeRhino: Boolean, GHForThumb: Boolean, additionalImgs: list, export: Boolean; plug-in component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

# ----
# Result 4 : %surface such as
# DF > requirement
# Run the analysis
# Put the recipie together!
# Daylight Factor Analysis
# Result 3 : average DF
# Visualize the results
# Result 5 : min DF
daylighfactorsimulation = Honeybee_DaylightFactorSimulation(
    testPoints=genhbzonetestpts.testPoints,
    ptsVectors=genhbzonetestpts.ptsVectors,
    testMesh=genhbzonetestpts.mesh,
    uniformSky=False)  # -> analysisRecipe; plug-in component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
rundaylightanalysis = Honeybee_RunDaylightSimulation(
    HBObjects=flatten([createhbsrfs.HBSurface, setradmaterials, brep]),
    analysisRecipe=daylighfactorsimulation,
    writeRad=toggle,
    runRad=toggle,
    numOfCPUs="4",
    overwriteResults=True)  # -> readMe, analysisType, resultsUnit, DF_values, testPts, DF_files, radGeoFile, studyFolder, done; plug-in component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
num = Number(rundaylightanalysis.DF_values)  # disabled
requirement = Slider(1.8, range=1..2)  # disabled
num_2 = Number(rundaylightanalysis.DF_values)
df = Average(Input=num)  # disabled
bnd = Bounds(Numbers=num_2)
panel_8 = Panel("100")  # disabled
panel_9 = Panel(">=")  # disabled
gradientlibrary = Ladybug_GradientLibrary(gradIndex=Slider(1, range=0..10))  # -> customColors; plug-in component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
dedomain = DeconstructDomain(Domain=bnd)  # -> Start, End
panel_10 = Panel(df)  # disabled
meshselector = Ladybug_MeshThresholdSelector(
    inputMesh=genhbzonetestpts.mesh,
    analysisResult=flatten(rundaylightanalysis.DF_values),
    operator=panel_9,
    percentToKeep=panel_8,
    levelOfPerform=requirement)  # -> readMe, totalValue, areaMeetsThresh, newColoredMesh, newMeshOutline; disabled; plug-in component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
legendpar = Ladybug_LegendParameters(
    lowBound=Slider(0, range=0..100),
    highBound=Slider(7, range=0..100),
    numSegments=Slider(6, range=0..10),
    customColors=flatten(gradientlibrary))  # -> legendPar; plug-in component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
area = Area(Geometry=genhbzonetestpts.mesh)  # -> Area, Centroid; disabled
division = Division(A=meshselector.areaMeetsThresh, B=area.Area)  # disabled
panel_11 = Panel(division)  # disabled
recolormesh = Ladybug_RecolorMesh(
    analysisResult=rundaylightanalysis.DF_values,
    inputMesh=genhbzonetestpts.mesh,
    legendPar=legendpar,
    analysisTitle=rundaylightanalysis.analysisType,
    legendTitle=rundaylightanalysis.resultsUnit)  # -> readMe, newMesh, newLegend, legendBasePt, meshColors, legendColors; plug-in component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

panel_12 = Panel(dedomain.Start)

# ----
# Use colibri to visualize all the results
# on design explorer
iterator = ColibriIterator(
    office_length=office_length,
    shading_depth=shading_depth,
    glazing_percent=glazing_percent,
    RemoteFly=False,
    ignoreAllWarningMsg=False)  # -> office_length, shading_depth, glazing_percent, Value_N, Genome
parameters = ColibriParameters(min_DF=flatten(panel_12))
aggregator = ColibriAggregator(
    Folder="C:\Colibri",
    IterationGenomeID=iterator.Genome,
    IterationPhenomeResults=parameters,
    Write=Toggle(False),
    recordingMode=3)

# ----
# Result 2 :
# %surface such as
# DLA > requirement
# Run the analysis
# Put the recipie together!
# Annual Daylight Analysis
# Result 1 : average DLA
# Generate annual results
# Visualize the results
annualdaylightsimulation = Honeybee_AnnualDaylightSimulation(
    epwWeatherFile=epw_stat.epwFile,
    testPoints=genhbzonetestpts.testPoints,
    ptsVectors=genhbzonetestpts.ptsVectors,
    testMesh=genhbzonetestpts.mesh)  # -> analysisRecipe; disabled; plug-in component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
panel_13 = Panel("4")  # disabled
rundaylightanalysis_2 = Honeybee_RunDaylightSimulation(
    HBObjects=flatten([brep, createhbsrfs.HBSurface, setradmaterials]),
    analysisRecipe=annualdaylightsimulation,
    writeRad=toggle,
    runRad=toggle,
    numOfCPUs=panel_13,
    overwriteResults=True)  # -> readMe, analysisType, resultsUnit, results, testPts, resultFiles, radGeoFile, studyFolder, done; disabled; plug-in component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
panel_14 = Panel("300")  # disabled
toggle_3 = BooleanToggle(True)  # disabled
readannualresultsi = Honeybee_ReadAnnualResultI(
    illFilesAddress=rundaylightanalysis_2.resultFiles,
    testPoints=simplify(rundaylightanalysis_2.testPts),
    occupancyFiles=annualschedule.schedule,
    DLAIllumThresholds=panel_14,
    runIt=toggle_3)  # -> DLA, UDLI_Less_100, UDLI_100_2000, UDLI_More_2000, CDA, sDA, annualProfiles, htmReport; disabled; plug-in component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
number_slider_7 = Slider(1, range=0..10)  # disabled
gradientlibrary_2 = Ladybug_GradientLibrary(gradIndex=number_slider_7)  # -> customColors; disabled; plug-in component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
number_slider_8 = Slider(100, range=0..100)  # disabled
number_slider_9 = Slider(0, range=0..100)  # disabled
number_slider_10 = Slider(6, range=0..10)  # disabled
requirement_2 = Slider(50, range=30..50)  # disabled
avr = Average(Input=readannualresultsi.DLA)  # disabled
panel_15 = Panel("100")  # disabled
panel_16 = Panel(">=")  # disabled
panel_17 = Panel(avr)  # disabled
number_slider_11 = Slider(0, range=0..1)  # disabled
legendpar_2 = Ladybug_LegendParameters(
    lowBound=number_slider_9,
    highBound=number_slider_8,
    numSegments=number_slider_10,
    customColors=flatten(gradientlibrary_2))  # -> legendPar; disabled; plug-in component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
meshselector_2 = Ladybug_MeshThresholdSelector(
    inputMesh=genhbzonetestpts.mesh,
    analysisResult=flatten(readannualresultsi.DLA),
    operator=panel_16,
    percentToKeep=panel_15,
    levelOfPerform=panel_17)  # -> readMe, totalValue, areaMeetsThresh, newColoredMesh, newMeshOutline; disabled; plug-in component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
area_2 = Area(Geometry=genhbzonetestpts.mesh)  # -> Area, Centroid; disabled
panel_18 = Panel("%")  # disabled
division_2 = Division(A=meshselector_2.areaMeetsThresh, B=area_2.Area)  # disabled
panel_19 = Panel(division_2)  # disabled
mesh = Mesh(meshselector_2.newColoredMesh)  # disabled
crv = Curve(meshselector_2.newMeshOutline)  # disabled

# ---- group: make it 3D!
dom = ConstructDomain(DomainStart=0, DomainEnd=number_slider_11)  # disabled

# ----
recolormesh_2 = Ladybug_RecolorMesh(
    analysisResult=readannualresultsi.DLA,
    inputMesh=genhbzonetestpts.mesh,
    heightDomain=dom,
    legendPar=legendpar_2,
    analysisTitle=rundaylightanalysis_2.analysisType,
    legendTitle=panel_18)  # -> readMe, newMesh, newLegend, legendBasePt, meshColors, legendColors; disabled; plug-in component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
